# Grasshopper definition Caracal_Compare_Example.gh (Grasshopper 1.0.8)
# plug-ins: Caracal

insulation = Panel("0.03")
aspect_ratio = Panel("2")
orientation = Panel("45")
wwr = Panel("0.65")
u_factor = Panel("1")
shgc = Panel("0.6")
lpd = Panel("6")
aspect_ratio_2 = Panel("2")
orientation_2 = Panel("45")
wwr_2 = Panel("0.35")
insulation_2 = Panel("0.03")
u_factor_2 = Panel("1")
shgc_2 = Panel("0.6")
lpd_2 = Panel("6")
caracal_design_inputs = CaracalDesignInputs(
    AspectRatio=aspect_ratio,
    Orientation=orientation,
    WWR=wwr,
    GlassUFactor=u_factor,
    SHGC=shgc,
    LightingPowerDensity=lpd,
    WallInsulationThickness=insulation)  # -> DesignInputObject, PreCheckStatus, Messages
caracal_design_inputs_2 = CaracalDesignInputs(
    AspectRatio=aspect_ratio_2,
    Orientation=orientation_2,
    WWR=wwr_2,
    GlassUFactor=u_factor_2,
    SHGC=shgc_2,
    LightingPowerDensity=lpd_2,
    WallInsulationThickness=insulation_2)  # -> DesignInputObject, PreCheckStatus, Messages
# A
caracal_analysis = CaracalAnalysis(DesignInputObject=caracal_design_inputs.DesignInputObject, Run=Toggle(True))  # -> ResultObject, AnalysisStatus, DomainStatus, Messages, Diagnostics
# B
caracal_analysis_2 = CaracalAnalysis(DesignInputObject=caracal_design_inputs_2.DesignInputObject, Run=Toggle(True))  # -> ResultObject, AnalysisStatus, DomainStatus, Messages, Diagnostics
caracal_result = CaracalResult(
    ResultObject=caracal_analysis.ResultObject,
    SelectedCoolingEbmFeature="aspect_ratio",
    SelectedCoolingEbmInteractionTermIndex=-1,
    SelectedEuiEbmFeature="aspect_ratio",
    SelectedEuiEbmInteractionTermIndex=-1,
    ShowCoolingEbmInteraction=False,
    ShowCoolingEbmRelationship=False,
    ShowCoolingLocalShap=True,
    ShowEuiEbmInteraction=False,
    ShowEuiEbmRelationship=False,
    ShowEuiLocalShap=True,
    ShowPredictionSummary=True)  # -> SimulationDerivedEUI, SimulationDerivedCoolingEUI, ExplanationSummary, DomainStatus, ModelInformation, ScopeSummary, Messages, InputSnapshot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
panel = Panel(caracal_analysis.AnalysisStatus)
panel_2 = Panel(caracal_analysis.DomainStatus)
caracal_result_2 = CaracalResult(
    ResultObject=caracal_analysis_2.ResultObject,
    SelectedCoolingEbmFeature="aspect_ratio",
    SelectedCoolingEbmInteractionTermIndex=-1,
    SelectedEuiEbmFeature="aspect_ratio",
    SelectedEuiEbmInteractionTermIndex=-1,
    ShowCoolingEbmInteraction=False,
    ShowCoolingEbmRelationship=False,
    ShowCoolingLocalShap=True,
    ShowEuiEbmInteraction=False,
    ShowEuiEbmRelationship=False,
    ShowEuiLocalShap=True,
    ShowPredictionSummary=True)  # -> SimulationDerivedEUI, SimulationDerivedCoolingEUI, ExplanationSummary, DomainStatus, ModelInformation, ScopeSummary, Messages, InputSnapshot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
panel_3 = Panel(caracal_analysis_2.AnalysisStatus)
panel_4 = Panel(caracal_analysis_2.DomainStatus)
caracal_compare = CaracalCompare(ResultA=caracal_analysis.ResultObject, ResultB=caracal_analysis_2.ResultObject)  # -> OptionAEUI, OptionBEUI, DeltaEUI, OptionACoolingEUI, OptionBCoolingEUI, DeltaCoolingEUI, CompatibilityStatus, ComparisonSummary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
panel_5 = Panel(caracal_compare.DeltaEUI)
panel_6 = Panel(caracal_compare.DeltaCoolingEUI)
