# Grasshopper definition Caracal_Quick_Start.gh (Grasshopper 1.0.8)
# plug-ins: Caracal

insulation = Panel("0.03")
aspect_ratio = Panel("2")
orientation = Panel("45")
wwr = Panel("0.65")
u_factor = Panel("1")
shgc = Panel("0.6")
lpd = Panel("6")
caracal_design_inputs = CaracalDesignInputs(
    AspectRatio=aspect_ratio,
    Orientation=orientation,
    WWR=wwr,
    GlassUFactor=u_factor,
    SHGC=shgc,
    LightingPowerDensity=lpd,
    WallInsulationThickness=insulation)  # -> DesignInputObject, PreCheckStatus, Messages
caracal_analysis = CaracalAnalysis(DesignInputObject=caracal_design_inputs.DesignInputObject, Run=Toggle(True))  # -> ResultObject, AnalysisStatus, DomainStatus, Messages, Diagnostics
caracal_result = CaracalResult(
    ResultObject=caracal_analysis.ResultObject,
    SelectedCoolingEbmFeature="aspect_ratio",
    SelectedCoolingEbmInteractionTermIndex=-1,
    SelectedEuiEbmFeature="aspect_ratio",
    SelectedEuiEbmInteractionTermIndex=-1,
    ShowCoolingEbmInteraction=False,
    ShowCoolingEbmRelationship=False,
    ShowCoolingLocalShap=True,
    ShowEuiEbmInteraction=False,
    ShowEuiEbmRelationship=False,
    ShowEuiLocalShap=True,
    ShowPredictionSummary=True)  # -> SimulationDerivedEUI, SimulationDerivedCoolingEUI, ExplanationSummary, DomainStatus, ModelInformation, ScopeSummary, Messages, InputSnapshot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
panel = Panel(caracal_analysis.AnalysisStatus)
panel_2 = Panel(caracal_analysis.DomainStatus)
